# Grasshopper definition Pavilha Nautilus Algoritmo.gh (Grasshopper 0.9.76)

panel = Panel("TERRENO")

largura = Slider(27, range=0..100)
panel_2 = Panel("Medidas do retângulo")
neg = Negative(Value=largura)
dom = ConstructDomain(DomainStart=largura, DomainEnd=neg)

# ----
# Número de pontos no círculo principal que definem quantos outros círculos são criados
number_slider = Slider(3, range=0..10)

# ----
# Circulo principal que define os pontos centrais dos demais círculos
number_slider_2 = Slider(13, range=0..100)
cir = Circle(Plane=PlaneXY(0, 0, 0), Radius=number_slider_2)

# ----
# CÍRCULO PRINCIPAL (DEFINIDOR DA DISTÂCIA DOS MODELOS)
divide = DivideCurve(Curve=cir, Count=number_slider, Kinks=False)  # -> Points, Tangents, Parameters

panel_3 = Panel("Retângulo")
rectangle = Rectangle(Plane=PlaneXY(0, 0, 0), XSize=dom, YSize=dom, Radius=0)  # -> Rectangle, Length

panel_4 = Panel("Círculos dos modelos")
cir_2 = Circle(Plane=divide.Points, Radius=Slider(5.066, range=0..10))

# ----
# Tornando retângulo em um plano com espessura
espessura = Slider(0.28, range=0..1)
boundary = BoundarySurfaces(Edges=rectangle.Rectangle)
neg_2 = Negative(Value=espessura)
Z = UnitZ(Factor=neg_2)
extr = Extrude(Base=boundary, Direction=Z)

# ----
# Número de faixas em cada círculo
number_slider_3 = Slider(12, range=0..100)

# ----
# Campos magnéticos entre o terreno e as faixas
number_slider_4 = Slider(1, range=0..1)
pcharge = PointCharge(Point=divide.Points, Charge=number_slider_4, Decay=Slider(1.4, range=0..10), Bounds=rectangle.Rectangle)

# ----
# Divisão dos círculos em pontos
divide_2 = DivideCurve(Curve=cir_2, Count=number_slider_3, Kinks=False)  # -> Points, Tangents, Parameters

panel_5 = Panel("Rotações")
fspin = SpinForce(
    Plane=divide.Points,
    Strength=Slider(0.4, range=0..1),
    Radius=Slider(6.2, range=0..10),
    Decay=Slider(1.6, range=0..10),
    Bounds=rectangle.Rectangle)

# ----
# O algoritmo se define pelas seguintes etapas:
# 1- Círculos-raiz;
# 2- Definição de pontos nestes círculos;
# 3- Criação de curvas que vão dos pontos dos círculos até o limite do terreno;
# 4- Definição do desenho dessas curvas;
# 5- Definição de tais curvas em "paredes".
panel_6 = Panel("PAVILHÃO")
mergef = MergeFields(Fields=[fspin, pcharge])

# ----
# Linhas das faixas a partir dos pontos
fline = FieldLine(Field=mergef, Point=divide_2.Points, Steps=1000, Accuracy=0.1, Method=3)

# ----
# Desenho das curvas das faixas
divide_3 = DivideCurve(Curve=fline, Count=10, Kinks=False)  # -> Points, Tangents, Parameters
nurbs = NurbsCurve(Vertices=divide_3.Points, Degree=3, Periodic=False)  # -> Curve, Length, Domain
curvepoint = PointOnCurve(nurbs.Curve, parameter=0.621)
pull = PullPoint(Point=divide_3.Points, Geometry=curvepoint, ClosestOnly=True)  # -> ClosestPoint, Distance
graph = GraphMapper(
    pull.Distance,
    x0=0,
    x1=25,
    y0=0,
    y1=25,
    container_name="Bezier",
    cpx=[0, 0.2158663124, 0.8285232186, 1],
    cpy=[0.0660674721, 0.0383278653, 0.4795508087, 0.05384226516])
Z_2 = UnitZ(Factor=graph)
move = Move(Geometry=divide_3.Points, Motion=Z_2)  # -> Geometry, Transform

nurbs_2 = NurbsCurve(Vertices=move.Geometry, Degree=3, Periodic=False)  # -> Curve, Length, Domain
panel_7 = Panel("Surface das \"paredes\"")
weave = Weave(Pattern=[0, 1], Stream0=nurbs.Curve, Stream1=nurbs_2.Curve, NullGaps=False)
loft = Loft(Curves=weave, Options={Adjust=False, Closed=False, LoftEnds=0, LoftSimp=0, LoftType=0, Rebuild=10, Refit=0.01})
