# Grasshopper definition PosteFilotaxico_TesteRadiacao1.gh (Grasshopper 0.9.76)
# plug-ins: Python Interpreter

panel = Panel("CILINDRO")

panel_2 = Panel("PONTOS")
panel_3 = Panel("DISTRIBUIÇÃO DOS PONTOS")

# ---- group: DIVISÃO DO CILINDRO EM SÉRIES / REGULAGEM DA ALTURA INICIAL
slider = Slider(1, range=0..10)

# ---- group: DIVISÃO DO CILINDRO EM SÉRIES / NÚMERO DE VEZES QUE A SÉRIE É APRESENTADA
slider_2 = Slider(1, range=0..10)

# ---- group: CILINDRO / ALTURA DO CILINDRO
altura_do_cilindro = Slider(100, range=0..1000)
escala = Slider(3.53, range=0..360)
panel_4 = Panel("?????")
multiplication = Multiplication(A=altura_do_cilindro, B=escala)

# ---- group: CILINDRO
raio_do_cilindro = Slider(50, range=0..500)
cyl = Cylinder(Base=PlaneXY(0, 0, 0), Radius=raio_do_cilindro, Length=multiplication)

# ---- group: DIVISÃO DO CILINDRO EM SÉRIES
series = Series(Start=slider, Step=slider_2, Count=altura_do_cilindro)

# ---- group: ÂNGULO
n_0_360 = Slider(129.676, range=0..360)
rad = Radians(Degrees=n_0_360)
multiplication_2 = Multiplication(A=series, B=rad)

# ---- group: SÉRIE x ESCALA
multiplication_3 = Multiplication(A=series, B=escala)

# ----
cap = CapHoles(Brep=cyl)

# ---- group: PONTOS
pt = PointCylindrical(BasePlane=PlaneXY(0, 0, 0), Angle=multiplication_2, Radius=raio_do_cilindro, Elevation=multiplication_3)

# ----
# CURVA QUE CONECTA OS PONTOS
pline = PolyLine(Vertices=pt, Closed=False)
crv = Curve(pline)
explode = Explode(Curve=crv, Recursive=True)  # -> Segments, Vertices

ladybug = Ladybug_Ladybug()  # -> Vviiiiiiiiiizzz; plug-in component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
panel_5 = Panel("http://climate.onebuilding.org/WMO_Region_3_South_America/BRA_Brazil/SP_Sao_Paulo/BRA_SP_Sao.Paulo-Congonhas.AP.837800_TMYx.zip")
epw_stat = Ladybug_OpenEPWAndSTATWeatherFiles(weatherFileURL=panel_5)  # -> epwFile, statFile; plug-in component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
downloadepw = Ladybug_downloadEPWWeatherFile(download=Toggle(False))  # -> readMe; plug-in component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
gencumulativeskymtx = Ladybug_GenCumulativeSkyMtx(epwFile=epw_stat.epwFile, skyDensity="0", useOldRes=True, runIt=Toggle(False))  # -> readMe, cumulativeSkyMtx; plug-in component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
analysisperiod = Ladybug_AnalysisPeriod(fromMonth="05", fromDay="02", fromHour="6", toMonth="05", toDay="02", toHour="18")  # -> readMe, analysisPeriod; plug-in component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
selectskymtx = Ladybug_selectSkyMtx(
    cumulativeSkyMtx=gencumulativeskymtx.cumulativeSkyMtx,
    analysisPeriod=analysisperiod.analysisPeriod,
    removeDiffuse=Toggle(True),
    removeDirect=False)  # -> readMe, selectedSkyMtx; plug-in component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
legendpar = Ladybug_LegendParameters(lowBound="0", highBound="100")  # -> legendPar; plug-in component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
terreno = Geometry(<brep referenced from the Rhino model>)
fotovoltaicas = Geometry([<brep referenced from the Rhino model> x50])
radiationanalysis = Ladybug_RadiationAnalysis(
    geometry=flatten([fotovoltaicas, terreno]),
    context=flatten([fotovoltaicas, terreno]),
    gridSize=Slider(2, range=0..10),
    disFromBase=Slider(0.1, range=0..0.1),
    selectedSkyMtx=flatten(selectskymtx.selectedSkyMtx),
    legendPar=flatten(legendpar),
    runIt=Toggle(True))  # -> readMe, contextMesh, analysisMesh, testPts, testVec, port, radiationResult, radiationMesh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; plug-in component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

graft = GraftTree(Data=pt, IncludeEmptyLists=True, IncludeNullItems=True)
n_0_10 = Slider(0, range=0..10)
cps = ClosestPoints(Point=graft, Cloud=pt, Count=2)  # -> ClosestPoint, CPIndex, Distance
panel_6 = Panel("SIMPLIFICAÇÃO DE LISTAS")
cull_i = CullIndex(List=cps.Distance, Indices=n_0_10, Wrap=False)
flatten = FlattenTree(Data=cull_i, Path="{0}")
sort = SortList(Keys=flatten)  # -> Keys, ValuesA
rev = ReverseList(List=sort.Keys)
item = ListItem(List=rev, Index=0, Wrap=False)
item_2 = ListItem(List=sort.Keys, Index=0, Wrap=False)
equals = Equality(FirstNumber=item_2, SecondNumber=flatten)  # -> Equality, Inequality
subtraction = Subtraction(A=item, B=item_2)
cull = CullPattern(List=flatten, CullPattern=equals.Equality)
abs = Absolute(Value=subtraction)
index = ItemIndex(List=flatten, Item=cull)
division = Division(A=item, B=2)

panel_7 = Panel("ESFERAS")
sph = Sphere(Base=pt, Radius=expr("x/2", item))

# ----
# Vetor de cada segmento
# Plano central
# Ângulo
shift = ShiftList(List=explode.Segments, Shift=1, Wrap=True)
graft_2 = GraftTree(Data=explode.Segments, IncludeEmptyLists=True, IncludeNullItems=True)
graft_3 = GraftTree(Data=shift, IncludeEmptyLists=True, IncludeNullItems=True)
simplify = SimplifyTree(Tree=graft_2, Front=False)
simplify_2 = SimplifyTree(Tree=graft_3, Front=False)
merge = Merge(Data1=simplify_2, Data2=simplify)
item_3 = ListItem(List=merge, Index=1, Wrap=False)
item_4 = ListItem(List=merge, Index=0, Wrap=False)
angle = Angle(VectorA=item_4, VectorB=item_3)  # -> Angle, Reflex
multiplication_4 = Multiplication(A=angle.Angle, B=-1)
division_2 = Division(A=multiplication_4, B=2)
xy = XYPlane(Origin=Point(0, 0, 0))
vec = Vector(graft_2)
vrot = Rotate(Vector=vec, Axis=xy, Angle=division_2)  # -> flatten(Vector)

# ----
# ROTAÇÃO DAS FACES EM SEU PRÓPRIO EIXO
# (bolhas)
rotação_das_faces = Slider(89.204, range=0..360)
rad_2 = Radians(Degrees=rotação_das_faces)

panel_8 = Panel("VETORES DAS FACES")
Z = UnitZ(Factor=1)
pl = Plane(Origin=pt, XAxis=vrot, YAxis=Z)
vec_2 = Vector(pl)
align = AlignPlanes(Planes=pl)
prot = RotatePlane(Plane=align, Angle=rad_2)

panel_9 = Panel("FACES")

formato_do_poligono = Slider(5, range=0..10)
tamanho_das_faces = Slider(24.824, range=17..30)
polygon = Polygon(Plane=prot, Radius=tamanho_das_faces, Segments=formato_do_poligono, FilletRadius=0)  # -> Polygon, Length

planar = PlanarSrf(Edges=polygon.Polygon)
