# Grasshopper definition TacaDeVidroCorreto.gh (Grasshopper 0.9.76)
# plug-ins: Biomorpher, Octopus

panel = Panel("CORPO")

panel_2 = Panel("BASE")
number = Number(0)
raio_base = Slider(3, range=3..6)
base = UnitZ(Factor=number)
borda = Circle(Plane=base, Radius=raio_base)

panel_3 = Panel("HASTE 2")
altura_haste_2 = Slider(2, range=1..5)
raio_haste_2 = Slider(4, range=3..5)
altura_haste = UnitZ(Factor=altura_haste_2)
haste = Circle(Plane=altura_haste, Radius=raio_haste_2)

panel_4 = Panel("COPO")
panel_5 = Panel("BASE COPO")
altura_base_copo = Slider(5, range=5..12)
number_slider = Slider(4, range=4..6)
altura_base_copo_2 = UnitZ(Factor=altura_base_copo)
base_copo = Circle(Plane=altura_base_copo_2, Radius=number_slider)

panel_6 = Panel("BORDA")
altura_borda = Slider(20, range=18..23)
raio_borda = Slider(6.534, range=5..10)
altura_borda_2 = UnitZ(Factor=altura_borda)
borda_2 = Circle(Plane=altura_borda_2, Radius=raio_borda)

panel_7 = Panel("CENTRO")
altura_centro = Slider(14, range=12..18)
raio_centro = Slider(10.344, range=10..15)
altura_centro_2 = UnitZ(Factor=altura_centro)
centro = Circle(Plane=altura_centro_2, Radius=raio_centro)

panel_8 = Panel("CENTRO LÍQUIDO")
number_2 = Number(0.09)
externo_x_interno = Subtraction(A=raio_centro, B=number_2)
centro_interna = Circle(Plane=altura_centro_2, Radius=externo_x_interno)
panel_9 = Panel(centro_interna)

panel_10 = Panel("BASE LÍQUIDO")
number_3 = Number(0.09)
externo_x_interno_2 = Addition(A=altura_base_copo, B=number_3)
unit_z = UnitZ(Factor=externo_x_interno_2)
circle = Circle(Plane=unit_z, Radius=number_slider)
panel_11 = Panel(circle)

panel_12 = Panel("BORDA LÍQUIDO")
number_4 = Number(0.09)
externo_x_interno_3 = Subtraction(A=raio_borda, B=number_4)
borda_interna = Circle(Plane=altura_borda_2, Radius=externo_x_interno_3)
panel_13 = Panel(borda_interna)

panel_14 = Panel("LÍQUIDO (COPO-INTERNOS)")
loft = Loft(
    Curves=[borda_interna, centro_interna, circle],
    Options={Adjust=False, Closed=False, LoftEnds=0, LoftSimp=0, LoftType=0, Rebuild=10, Refit=0.01})
líquido = CapHoles(Brep=loft)
smooth_mesh = SmoothMesh(Mesh=líquido, Strength=0.5, SkipNaked=True, Iterations=1)
colour_picker = ColourPicker(PickedColour=RGB(16, 0, 69))
panel_15 = Panel("VOLUME DO LÍQUIDO")
custom_preview = CustomPreview(Geometry=smooth_mesh, Shader=colour_picker)

panel_16 = Panel("TAÇA")
loft_2 = Loft(
    Curves=[borda_2, centro, base_copo, haste, borda],
    Options={Adjust=False, Closed=False, LoftEnds=0, LoftSimp=0, LoftType=0, Rebuild=10, Refit=0.01})
cap_holes = CapHoles(Brep=loft_2)
smooth_mesh_2 = SmoothMesh(Mesh=cap_holes, Strength=0.5, SkipNaked=True, Iterations=1)
taça_final = SolidDifference(BrepsA=cap_holes, BrepsB=líquido)
panel_17 = Panel("VOLUME DA TAÇA")
volumetaça = Volume(Geometry=taça_final)  # -> Volume, Centroid

minimizar_taça = Number(volumetaça.Volume)

panel_18 = Panel("AG INTERATIVOS")
biomorpher = Biomorpher(
    Genome=[altura_haste_2, raio_haste_2, raio_base, number_slider, altura_base_copo, raio_centro, altura_centro, raio_borda, altura_borda],
    MeshEs=smooth_mesh_2,
    Performance=volumetaça.Volume)  # -> GenoGuids, Population, Historic, Clusters
octopus = Octopus(
    OctopusData_gene=[raio_base, raio_haste_2, altura_haste_2, number_slider, altura_base_copo, raio_centro, altura_centro, raio_borda, altura_borda],
    OctopusData_obj=[maximizar_liquido, minimizar_taça])
panel_19 = Panel("BIOMORPHER")
panel_20 = Panel("OCTOPUS")

galapagos = Galapagos(
    fitness=volumetaça,
    gene=[raio_base, raio_haste_2, altura_haste_2, number_slider, altura_base_copo, raio_centro, altura_centro, raio_borda, altura_borda])

panel_21 = Panel("AG CLÁSSICO")
panel_22 = Panel("GALÁPAGOS")

volume = Volume(Geometry=líquido)  # -> Volume, Centroid
maximizar_liquido = Number(volume.Volume)
panel_23 = Panel([maximizar_liquido, minimizar_taça])
panel_24 = Panel(volume.Volume)
